# Grasshopper definition vasija.gh (Grasshopper 1.0.8)

number_slider = Slider(15, range=0..100)
construct_point = ConstructPoint(XCoordinate=number_slider, YCoordinate=number_slider, ZCoordinate=0)
unit_z = UnitZ(Factor=Slider(10, range=0..10))
extrude = Extrude(Base=construct_point, Direction=unit_z)
circle_cnr = CircleCNR(Center=construct_point, Normal=Vector(0, 0, 1), Radius=Slider(10, range=0..10))
divide_curve = DivideCurve(Curve=circle_cnr, Count=Slider(20, range=0..100), Kinks=False)  # -> Points, Tangents, Parameters
rotate_axis = RotateAxis(Geometry=divide_curve.Points, Angle=Slider(20, range=0..100), Axis=extrude)  # -> Geometry, Transform
circle_cnr_2 = CircleCNR(Center=divide_curve.Points, Normal=circle_cnr, Radius=Slider(1, range=0..1))
circle_cnr_3 = CircleCNR(Center=rotate_axis.Geometry, Normal=Vector(0, 0, 1), Radius=Slider(0.6, range=0..1))
trim_with_region = TrimWithRegion(Curve=circle_cnr_2, Region=circle_cnr)  # -> Inside, flatten(Outside)
trim_with_region_2 = TrimWithRegion(Curve=circle_cnr_3, Region=circle_cnr)  # -> Inside, flatten(Outside)
curve = Curve(trim_with_region.Outside)
curve_2 = Curve(trim_with_region_2.Outside)
trim_with_regions = TrimWithRegions(Curve=curve, Regions=circle_cnr_3)  # -> Inside, flatten(Outside)
trim_with_regions_2 = TrimWithRegions(Curve=curve_2, Regions=circle_cnr_2)  # -> Inside, flatten(Outside)
trim_with_regions_3 = TrimWithRegions(Curve=circle_cnr, Regions=[circle_cnr_3, circle_cnr_2])  # -> Inside, Outside
curve_3 = Curve(trim_with_regions_3.Outside)
curve_4 = Curve(trim_with_regions.Outside)
curve_5 = Curve(trim_with_regions_2.Outside)
unit_z_2 = UnitZ(Factor=Slider(85, range=0..100))
list_item = ListItem(List=divide_curve.Points, Index=0, Wrap=True)
extrude_2 = Extrude(Base=list_item, Direction=unit_z_2)
divide_curve_2 = DivideCurve(Curve=extrude_2, Count=Slider(3, range=0..10), Kinks=False)  # -> Points, Tangents, Parameters
list_item_2 = ListItem(List=divide_curve_2.Points, Index=Slider(4, range=0..10), Wrap=True)
list_item_3 = ListItem(List=divide_curve_2.Points, Index=Slider(2, range=0..10), Wrap=True)
negative = Negative(Value=Slider(17, range=0..100))
unit_x = UnitX(Factor=Slider(10, range=0..100))
unit_x_2 = UnitX(Factor=negative)
move = Move(Geometry=list_item_2, Motion=unit_x)  # -> Geometry, Transform
move_2 = Move(Geometry=list_item_3, Motion=unit_x_2)  # -> Geometry, Transform
list_item_4 = ListItem(List=divide_curve_2.Points, Index=0, Wrap=True)
list_item_5 = ListItem(List=divide_curve_2.Points, Index=Slider(3, range=0..10), Wrap=True)
nurbs_curve = NurbsCurve(Vertices=[list_item_4, move.Geometry, move_2.Geometry, list_item_5], Degree=3, Periodic=False)  # -> Curve, Length, Domain
merge = Merge(Data1=curve_3, Data2=curve_4, Data3=curve_5)  # -> flatten(Result)
rail_revolution = RailRevolution(Curve=merge, Rail=nurbs_curve.Curve, Axis=extrude, Scale=False)
custom_preview = CustomPreview(Geometry=rail_revolution, Material=ColourSwatch(SwatchColor=RGB(255, 255, 255)))
